# Grasshopper definition 00_define_simple_goals.ghx (Grasshopper 1.0.7)

number_slider = Slider(0, range=0..8)
box = Box()
insert_items = InsertItems(Item=box, Indices=Slider(8, range=0..10), Wrap=True)

# ----
# Goal 00
box_2 = Box([{Plane=PlaneXY(-0.15, -0.15, -0.15), X=Domain(0, 0.3), Y=Domain(0, 0.3), Z=Domain(0, 0.3)}, {Plane=Plane(origin=(-0.15, 0.5008, -0.1500000001), x=(1, 0, 0), y=(0, -1, 0)), X=Domain(0, 0.3), Y=Domain(0, 0.3), Z=Domain(-0.3, 0)}, {Plane=Plane(origin=(0.2008, 0.15, -0.15), x=(1, 0, 0), y=(0, -1, 0)), X=Domain(0, 0.3), Y=Domain(0, 0.3), Z=Domain(-0.3, 0)}, {Plane=PlaneXY(0.2008, 0.2008, -0.1500000001), X=Domain(0, 0.3), Y=Domain(0, 0.3), Z=Domain(0, 0.3)}, {Plane=PlaneXY(0.5516, -0.15, -0.15), X=Domain(0, 0.3), Y=Domain(0, 0.3), Z=Domain(0, 0.3)}, {Plane=PlaneXY(0.5516, 0.2008, -0.1500000001), X=Domain(0, 0.3), Y=Domain(0, 0.3), Z=Domain(0, 0.3)}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])
panel = Panel("Goal00")

# ----
# Goal 01
box_3 = Box([{Plane=PlaneXY(-0.15, -0.15, -0.15), X=Domain(0, 0.3), Y=Domain(0, 0.3), Z=Domain(0, 0.3)}, {Plane=Plane(origin=(0.2008, 0.15, -0.15), x=(1, 0, 0), y=(0, -1, 0)), X=Domain(0, 0.3), Y=Domain(0, 0.3), Z=Domain(-0.3, 0)}, {Plane=Plane(origin=(0.5516, 0.15, -0.15), x=(1, 0, 0), y=(0, -1, 0)), X=Domain(0, 0.3), Y=Domain(0, 0.3), Z=Domain(-0.3, 0)}, {Plane=PlaneXY(0.9024, -0.15, -0.1500000001), X=Domain(0, 0.3), Y=Domain(0, 0.3), Z=Domain(0, 0.3)}, {Plane=PlaneXY(1.2532, -0.15, -0.1500000001), X=Domain(0, 0.3), Y=Domain(0, 0.3), Z=Domain(0, 0.3)}, {Plane=Plane(origin=(1.604, 0.15, -0.1500000001), x=(1, 0, 0), y=(0, -1, 0)), X=Domain(0, 0.3), Y=Domain(0, 0.3), Z=Domain(-0.3, 0)}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])
panel_2 = Panel("Goal01")

# ----
# Goal 02
box_4 = Box([{Plane=PlaneXY(-0.15, -0.15, -0.15), X=Domain(0, 0.3), Y=Domain(0, 0.3), Z=Domain(0, 0.3)}, {Plane=Plane(origin=(0.2008, 0.15, -0.15), x=(1, 0, 0), y=(0, -1, 0)), X=Domain(0, 0.3), Y=Domain(0, 0.3), Z=Domain(-0.3, 0)}, {Plane=Plane(origin=(0.5516, 0.15, -0.15), x=(1, 0, 0), y=(0, -1, 0)), X=Domain(0, 0.3), Y=Domain(0, 0.3), Z=Domain(-0.3, 0)}, {Plane=PlaneXY(-0.15, 0.2008, -0.1500000001), X=Domain(0, 0.3), Y=Domain(0, 0.3), Z=Domain(0, 0.3)}, {Plane=PlaneXY(0.5516, 0.2008, -0.1500000001), X=Domain(0, 0.3), Y=Domain(0, 0.3), Z=Domain(0, 0.3)}, {Plane=PlaneXY(-0.15, 0.5516, -0.1500000003), X=Domain(0, 0.3), Y=Domain(0, 0.3), Z=Domain(0, 0.3)}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])
panel_3 = Panel("Goal02")

# ----
# Goal 09
box_5 = Box([{Plane=PlaneXY(-0.15, -0.15, -0.15), X=Domain(0, 0.3), Y=Domain(0, 0.3), Z=Domain(0, 0.3)}, {Plane=Plane(origin=(-0.15, 0.5008, -0.1500000003), x=(1, 0, 0), y=(0, -1, 0)), X=Domain(0, 0.3), Y=Domain(0, 0.3), Z=Domain(-0.3, 0)}, {Plane=Plane(origin=(0.2008, 0.15, -0.1499999999), x=(1, 0, 0), y=(0, -1, 0)), X=Domain(0, 0.3), Y=Domain(0, 0.3), Z=Domain(-0.3, 0)}, {Plane=PlaneXY(-0.15, 0.5516, -0.1500000011), X=Domain(0, 0.3), Y=Domain(0, 0.3), Z=Domain(0, 0.3)}, {Plane=PlaneXY(0.5516, -0.15, -0.1499999997), X=Domain(0, 0.3), Y=Domain(0, 0.3), Z=Domain(0, 0.3)}, {Plane=PlaneXY(0.9024, -0.15, -0.1499999996), X=Domain(0, 0.3), Y=Domain(0, 0.3), Z=Domain(0, 0.3)}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])

list_item = ListItem(List=box_5, Index=number_slider, Wrap=True)

panel_4 = Panel("Goal05")
# Goal 05
box_6 = Box([{Plane=PlaneXY(-0.15, -0.15, -0.15), X=Domain(0, 0.3), Y=Domain(0, 0.3), Z=Domain(0, 0.3)}, {Plane=PlaneXY(0.2008, -0.15, -0.15), X=Domain(0, 0.3), Y=Domain(0, 0.3), Z=Domain(0, 0.3)}, {Plane=Plane(origin=(-0.15, 0.5008, -0.1500000001), x=(1, 0, 0), y=(0, -1, 0)), X=Domain(0, 0.3), Y=Domain(0, 0.3), Z=Domain(-0.3, 0)}, {Plane=Plane(origin=(0.5516, 0.15, -0.15), x=(1, 0, 0), y=(0, -1, 0)), X=Domain(0, 0.3), Y=Domain(0, 0.3), Z=Domain(-0.3, 0)}, {Plane=Plane(origin=(-0.15, 0.8516, -0.1500000003), x=(1, 0, 0), y=(0, -1, 0)), X=Domain(0, 0.3), Y=Domain(0, 0.3), Z=Domain(-0.3, 0)}, {Plane=PlaneXY(0.9024, -0.15, -0.1500000003), X=Domain(0, 0.3), Y=Domain(0, 0.3), Z=Domain(0, 0.3)}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])

panel_5 = Panel("Goal06")
# Goal 06
box_7 = Box([{Plane=Plane(origin=(-0.15, 0.15, -0.15), x=(1, 0, 0), y=(0, -1, 0)), X=Domain(0, 0.3), Y=Domain(0, 0.3), Z=Domain(-0.3, 0)}, {Plane=Plane(origin=(-0.15, 0.5008, -0.1500000001), x=(1, 0, 0), y=(0, -1, 0)), X=Domain(0, 0.3), Y=Domain(0, 0.3), Z=Domain(-0.3, 0)}, {Plane=PlaneXY(0.2008, -0.15, -0.15), X=Domain(0, 0.3), Y=Domain(0, 0.3), Z=Domain(0, 0.3)}, {Plane=Plane(origin=(0.2008, 0.5008, -0.1500000004), x=(1, 0, 0), y=(0, -1, 0)), X=Domain(0, 0.3), Y=Domain(0, 0.3), Z=Domain(-0.3, 0)}, {Plane=PlaneXY(0.5516, -0.15, -0.15), X=Domain(0, 0.3), Y=Domain(0, 0.3), Z=Domain(0, 0.3)}, {Plane=PlaneXY(0.5516, 0.2008, -0.15), X=Domain(0, 0.3), Y=Domain(0, 0.3), Z=Domain(0, 0.3)}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])

panel_6 = Panel("Goal07")
# Goal 07
box_8 = Box([{Plane=PlaneXY(-0.15, -0.15, -0.15), X=Domain(0, 0.3), Y=Domain(0, 0.3), Z=Domain(0, 0.3)}, {Plane=Plane(origin=(-0.15, 0.5008, -0.1500000001), x=(1, 0, 0), y=(0, -1, 0)), X=Domain(0, 0.3), Y=Domain(0, 0.3), Z=Domain(-0.3, 0)}, {Plane=Plane(origin=(0.2008, 0.15, -0.15), x=(1, 0, 0), y=(0, -1, 0)), X=Domain(0, 0.3), Y=Domain(0, 0.3), Z=Domain(-0.3, 0)}, {Plane=PlaneXY(0.2008, 0.2008, -0.1500000001), X=Domain(0, 0.3), Y=Domain(0, 0.3), Z=Domain(0, 0.3)}, {Plane=Plane(origin=(0.5516, 0.15, -0.15), x=(1, 0, 0), y=(0, -1, 0)), X=Domain(0, 0.3), Y=Domain(0, 0.3), Z=Domain(-0.3, 0)}, {Plane=Plane(origin=(0.9024, 0.15, -0.15), x=(1, 0, 0), y=(0, -1, 0)), X=Domain(0, 0.3), Y=Domain(0, 0.3), Z=Domain(-0.3, 0)}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])

panel_7 = Panel("Goal08")
# Goal 08
box_9 = Box([{Plane=PlaneXY(-0.15, -0.15, -0.15), X=Domain(0, 0.3), Y=Domain(0, 0.3), Z=Domain(0, 0.3)}, {Plane=PlaneXY(0.2008, -0.15, -0.1499999999), X=Domain(0, 0.3), Y=Domain(0, 0.3), Z=Domain(0, 0.3)}, {Plane=PlaneXY(0.5516, -0.15, -0.1499999997), X=Domain(0, 0.3), Y=Domain(0, 0.3), Z=Domain(0, 0.3)}, {Plane=Plane(origin=(0.2008, 0.5008, -0.15), x=(1, 0, 0), y=(0, -1, 0)), X=Domain(0, 0.3), Y=Domain(0, 0.3), Z=Domain(-0.3, 0)}, {Plane=PlaneXY(0.5516, 0.2008, -0.1499999999), X=Domain(0, 0.3), Y=Domain(0, 0.3), Z=Domain(0, 0.3)}, {Plane=PlaneXY(0.9024, 0.2008, -0.1499999997), X=Domain(0, 0.3), Y=Domain(0, 0.3), Z=Domain(0, 0.3)}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])

panel_8 = Panel("Goal04")
# Goal 04
box_10 = Box([{Plane=Plane(origin=(-0.15, 0.15, -0.15), x=(1, 0, 0), y=(0, -1, 0)), X=Domain(0, 0.3), Y=Domain(0, 0.3), Z=Domain(-0.3, 0)}, {Plane=PlaneXY(0.2008, -0.15, -0.1500000003), X=Domain(0, 0.3), Y=Domain(0, 0.3), Z=Domain(0, 0.3)}, {Plane=PlaneXY(0.5516, -0.15, -0.1500000003), X=Domain(0, 0.3), Y=Domain(0, 0.3), Z=Domain(0, 0.3)}, {Plane=Plane(origin=(0.9024, 0.15, -0.1500000003), x=(1, 0, 0), y=(0, -1, 0)), X=Domain(0, 0.3), Y=Domain(0, 0.3), Z=Domain(-0.3, 0)}, {Plane=Plane(origin=(0.9024, 0.5008, -0.1500000001), x=(1, 0, 0), y=(0, -1, 0)), X=Domain(0, 0.3), Y=Domain(0, 0.3), Z=Domain(-0.3, 0)}, {Plane=PlaneXY(0.9024, 0.5516, -0.15), X=Domain(0, 0.3), Y=Domain(0, 0.3), Z=Domain(0, 0.3)}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])

panel_9 = Panel("Goal03")
# Goal 03
box_11 = Box([{Plane=Plane(origin=(-0.15, 0.15, -0.15), x=(1, 0, 0), y=(0, -1, 0)), X=Domain(0, 0.3), Y=Domain(0, 0.3), Z=Domain(-0.3, 0)}, {Plane=PlaneXY(0.2008, -0.15, -0.15), X=Domain(0, 0.3), Y=Domain(0, 0.3), Z=Domain(0, 0.3)}, {Plane=PlaneXY(0.2008, 0.2008, -0.1500000001), X=Domain(0, 0.3), Y=Domain(0, 0.3), Z=Domain(0, 0.3)}, {Plane=PlaneXY(0.5516, -0.15, -0.15), X=Domain(0, 0.3), Y=Domain(0, 0.3), Z=Domain(0, 0.3)}, {Plane=Plane(origin=(0.5516, 0.5008, -0.1500000001), x=(1, 0, 0), y=(0, -1, 0)), X=Domain(0, 0.3), Y=Domain(0, 0.3), Z=Domain(-0.3, 0)}, {Plane=Plane(origin=(0.9024, 0.15, -0.15), x=(1, 0, 0), y=(0, -1, 0)), X=Domain(0, 0.3), Y=Domain(0, 0.3), Z=Domain(-0.3, 0)}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])

panel_10 = Panel("C:\Users\jk6372\Desktop\00_princeton_projects\00_robotic_territories\00_git\compas_xr_robotic_territories\dev\performance_operations\inference\goals")
ghpython_script = GhPythonScript(folder_fp=panel_10, box_list=box_5, name="Goal09", write=Button())  # -> out, box_frames; inputs box_list: list of Box, write: Boolean
# ---------- ghpython_script: Python ----------
import os
from compas_rhino.conversions import box_to_compas, frame_to_rhino
from compas.data import json_dump

goal_data = {}
goal_data["name"] = name
goal_data["cube_locations"] = {}

goal_fp = os.path.join(folder_fp, str(name+".json"))

box_frames = []

for i,box in enumerate(box_list):
    compas_box = box_to_compas(box)
    key = "G"+str(i)
    goal_data["cube_locations"][key] = compas_box
    box_frames.append(frame_to_rhino(compas_box.frame))

if write:
    json_dump(data=goal_data, fp=goal_fp, pretty=True)
# ---------- end ghpython_script ----------
list_item_2 = ListItem(List=ghpython_script.box_frames, Index=number_slider, Wrap=True)
